# Grasshopper definition VR_views.gh (Grasshopper 0.9.76)
# plug-ins: ghJSON

file = ReadFile(File="C:\Users\starsky\stealingfire\VRviews.json", PerLineParse=True)
frmjson = FromJSON(JSON=file)
panel = Panel("""    "_id" : ObjectId("5ae8a3ce4a3b8f2a8cdbd4c7"),
    "current_date" : Date(-62135596800000),
    "UserNumber" : 77,
    "SceneBuildIndex" : 3,
    "HeatSet_x" : 0.583095133304596,
    "HeatSet_x_y" : 1.50460112094879,
    "HeatSet_x_z" : 0.178585857152939,
    "Gaze_x" : 0.357513904571533,
    "Gaze_y" : 1.38861882686615,
    "Gaze_z" : -1.80526435375214""")
jpath = JSONPath(JObject=frmjson, JSONPathQuery="$.HeatSet_x")  # -> flatten(Data)
jpath_2 = JSONPath(JObject=frmjson, JSONPathQuery="$.UserNumber")  # -> flatten(Data)
jpath_3 = JSONPath(JObject=frmjson, JSONPathQuery="HeatSet_x_y")  # -> flatten(Data)
jpath_4 = JSONPath(JObject=frmjson, JSONPathQuery="HeatSet_x_z")  # -> flatten(Data)
jpath_5 = JSONPath(JObject=frmjson, JSONPathQuery="$.Gaze_x")  # -> flatten(Data)
jpath_6 = JSONPath(JObject=frmjson, JSONPathQuery="$.Gaze_y")  # -> flatten(Data)
jpath_7 = JSONPath(JObject=frmjson, JSONPathQuery="$.Gaze_z")  # -> flatten(Data)
number_slider = Slider(0.1, range=0..0.1)
number_slider_2 = Slider(1, range=0..1)
panel_2 = Panel(jpath_2)
pt = ConstructPoint(XCoordinate=jpath, YCoordinate=jpath_3, ZCoordinate=jpath_4)
pt_2 = ConstructPoint(XCoordinate=jpath_5, YCoordinate=jpath_6, ZCoordinate=jpath_7)
ln = Line(StartPoint=pt, EndPoint=pt_2)
vdisex = VectorDisplayEx(Point=pt_2, Vector=ln, Colour=RGB(0, 0, 0), Width=Slider(0.6, range=0..1))
vdis = VectorDisplay(Anchor=pt_2, Vector=ln)
